# Dynamo graph script.dyn "Floor_by_Room" (Dynamo 2.12.1.8246)

categories = Categories("OST_Rooms")
all_elements_of_category = ElementsOfCategory(Category=categories)
finishBoundary = Room.FinishBoundary(room=all_elements_of_category)
element_types = ElementTypes("FloorType")
all_elements_of_type = ElementsOfType(element_type=element_types)
firstItem = List.FirstItem(list=all_elements_of_type)
string_from_object = FromObject(object=all_elements_of_type)
code_block = CodeBlock { "Fußboden"; }
getParameterValueByName = Element.GetParameterValueByName(element=all_elements_of_category, parameterName=code_block)
string_from_object_2 = FromObject(object=getParameterValueByName)
contains = String.Contains(string=string_from_object, searchFor=string_from_object_2)
filterByBoolMask = List.FilterByBoolMask(list=firstItem, mask=contains)
levels = Levels("Ebene 1")
byOutlineTypeAndLevel = Floor.ByOutlineTypeAndLevel(outlineCurves=finishBoundary, floorType=filterByBoolMask.in, level=levels, lacing=Longest)
