# Dynamo graph script.dyn (Dynamo 2.12.0.5650)
# packages: MeshToolkit 3.0.0

pyPickObject = Python()  # IronPython2
# ---------- pyPickObject.python (32 lines) ----------
import clr

clr.AddReference('RevitAPI')
from Autodesk.Revit.DB import *
from Autodesk.Revit.DB.Structure import *

clr.AddReference('RevitAPIUI')
from Autodesk.Revit.UI import *

clr.AddReference('System')
from System.Collections.Generic import List

clr.AddReference('RevitNodes')
import Revit
clr.ImportExtensions(Revit.GeometryConversion)
clr.ImportExtensions(Revit.Elements)

clr.AddReference('RevitServices')
import RevitServices
from RevitServices.Persistence import DocumentManager
from RevitServices.Transactions import TransactionManager
from Autodesk.Revit.UI.Selection import ObjectType

doc = DocumentManager.Instance.CurrentDBDocument
uidoc=DocumentManager.Instance.CurrentUIApplication.ActiveUIDocument
selection = uidoc.Selection #type: Selection


ref_picked_object = selection.PickObject(ObjectType.Element)
picked_object     = doc.GetElement(ref_picked_object)

OUT = picked_object
# ----------------------------------------
geometry = Element.Geometry(element=pyPickObject)
code_block = CodeBlock(x=geometry) { filter = DSCore.Object.Type(x) == "Autodesk.DesignScript.Geometry.Solid" ? x : null; OUT = List.Clean(filter, false); }
byUnion = Solid.ByUnion(solids=code_block.OUT)
byGeometry = Autodesk.Dynamo.MeshToolkit.Mesh.ByGeometry(inputGeometry=byUnion)
n3DShape = Python(IN[0]=byGeometry)  # "3DShape"; IronPython2
# ---------- n3DShape.python (99 lines) ----------
import clr
import sys
import System
clr.AddReference("System.Numerics")

clr.AddReference('HelixToolkit')
clr.AddReference('SharpDX.Mathematics')
clr.AddReference('HelixToolkit.Core.Wpf')
clr.AddReference('HelixToolkit.SharpDX.Core')
clr.AddReference('HelixToolkit.SharpDX.Core.Wpf')
from HelixToolkit import *
from HelixToolkit.Wpf.SharpDX import *
from HelixToolkit.SharpDX.Core import *
from SharpDX import *
import SharpDX
#
clr.AddReference('ProtoGeometry')
from Autodesk.DesignScript.Geometry import *
import Autodesk.DesignScript.Geometry as DS


clr.AddReference("System.Core")
clr.ImportExtensions(System.Linq)
clr.AddReference("IronPython.Wpf")
clr.AddReference('System.Core')
clr.AddReference('System.Xml')
clr.AddReference('PresentationCore')
clr.AddReference('PresentationFramework')
clr.AddReferenceByPartialName("WindowsBase")

    
from System.IO import StringReader
from System.Windows.Markup import XamlReader, XamlWriter
from System.Windows import Window, Application

try:
    import wpf
    import time
except ImportError:
    wpf = None


class MeshViewer(Window):
    LAYOUT = '''
    <Window xmlns="http://schemas.microsoft.com/winfx/2006/xaml/presentation" 
        xmlns:x="http://schemas.microsoft.com/winfx/2006/xaml"
        xmlns:hx="http://helix-toolkit.org/wpf"
        Title="..."
        Height="700"
        Width="600">
        <Grid>
        <Viewbox Grid.Row="0">
            <hx:HelixViewport3D 
                Height="400" 
                Width="400" 
                VerticalAlignment="Bottom" 
                ZoomExtentsWhenLoaded="True"  
                CameraRotationMode="Trackball" 
                IsViewCubeEdgeClicksEnabled="True" 
                ZoomAroundMouseDownPoint="True" 
                 Margin="5,35,5,2">
                <hx:DefaultLights/>
                <ModelVisual3D>
                    <ModelVisual3D.Content>
                        <GeometryModel3D x:Name="model3D">
                            <GeometryModel3D.Geometry >
                                <MeshGeometry3D x:Name="meshMain">
                                </MeshGeometry3D>
                            </GeometryModel3D.Geometry>
                             <GeometryModel3D.Material>
                             <DiffuseMaterial x:Name="matDiffuseMain">
                                    <DiffuseMaterial.Brush>
                                        <SolidColorBrush Color="Gray"/>
                                    </DiffuseMaterial.Brush>
                                </DiffuseMaterial>
                        </GeometryModel3D.Material>
                        </GeometryModel3D>
                    </ModelVisual3D.Content>
                </ModelVisual3D>
                <hx:GridLinesVisual3D Width="8" Length="8" MinorDistance="1" MajorDistance="1" Thickness="0.01"/>
            </hx:HelixViewport3D >
        </Viewbox>
        </Grid>
    </Window>
    '''
    
    def __init__(self, mesh):
        self.ui = wpf.LoadComponent(self, StringReader(MeshViewer.LAYOUT))
        self.mesh = mesh
        self.Title = "3D Viewer"
        indices = System.Windows.Media.Int32Collection([System.Int32(i) for i in mesh.VertexIndicesByTri()])
        positions = System.Windows.Media.Media3D.Point3DCollection([System.Windows.Media.Media3D.Point3D(p.X, p.Y, p.Z) for p in mesh.Vertices()])
        self.meshMain.TriangleIndices = indices
        self.meshMain.Positions = positions
        
if wpf is not None:
    input_mesh = IN[0]
    mesh_viewer = MeshViewer(input_mesh)
    mesh_viewer.Show()
# ----------------------------------------
